# Grasshopper definition GHSolar_Test.gh (Grasshopper 0.9.76)
# plug-ins: GHSolar

# ---- group: Data reader
panel = Panel("C:\Users\wach\Desktop\SolarV2\DNI.txt")  # disabled
panel_2 = Panel("C:\Users\wach\Desktop\SolarV2\DHI.txt")  # disabled
panel_3 = Panel("C:\Users\wach\Desktop\SolarV2\SNOW.txt")  # disabled
readtxt = ReadText(Path=panel)  # disabled
readtxt_2 = ReadText(Path=panel_2)  # disabled
readtxt_3 = ReadText(Path=panel_3)  # disabled

# ---- group: analysis surface
srf = Surface(<surface referenced from the Rhino model>)
mesh_uv = MeshSurface(Surface=srf, UCount=Slider(10, range=0..100), VCount=Slider(10, range=0..100), Overhang=True, Equalize=False)

# ----
data = Data([0, 0, 0, 0, 0, 0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])
data_2 = Data([0, 0, 0, 0, 0, 0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])
data_3 = Data([0, 0, 0, 0, 0, 0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])

# ---- group: obstacles
mesh = Mesh(<mesh referenced from the Rhino model>)

# ----
srf_2 = Surface(<surface referenced from the Rhino model>)

# ---- group: weather
panel_4 = Panel(data)
panel_5 = Panel(data_2)
panel_6 = Panel(data_3)

# ----
mesh_2 = Mesh([mesh, mesh_uv])
panel_7 = Panel("""0
0
0
0
0
0""")
obstobj = ObstacleObject(Mesh=mesh_2, Albedo=panel_7, Reflection="0")

# ---- group: Latitude
panel_8 = Panel("47.367347")

# ---- group: Longitude
panel_9 = Panel("8.5500025")

# ----
mesh_uv_2 = MeshSurface(Surface=srf_2, UCount="2", VCount="2", Overhang=True, Equalize=False)
item = ListItem(List=flatten(mesh_uv_2), Index=0, Wrap=True)
mesh_3 = Mesh(item)
irrmshh = IrradiationMeshhour(
    AnalysisMesh=mesh_uv,
    ObstacleObjects=obstobj,
    Φ=panel_8,
    Λ=panel_9,
    DNI=panel_6,
    DHI=panel_4,
    Snow=panel_5,
    Year="2013",
    Month=Slider(2, range=1..12),
    Day=Slider(12, range=1..30),
    Hour=Slider(12, range=0..23),
    SkydomeResolution="1")  # -> TotalI, Ib, Ih; disabled
irrmshy = IrradiationMeshYear(
    AnalysisMesh=mesh_uv,
    ObstacleObjects=obstobj,
    Latitude=panel_8,
    Longitude=panel_9,
    DNI=panel_6,
    DHI=panel_4,
    Snow=panel_5,
    Year="2013",
    SkydomeResolution="1",
    MT=Toggle(True))  # -> IAnnual, IbAnnual, IhAnnual, IHourly, IbHourly, IhHourly
panel_10 = Panel(irrmshh.TotalI)
matrix = Matrix(irrmshy.IHourly)
vb = VBScript(x=matrix, y=Slider(2, range=0..7))  # -> out, A
# ---------- vb: VB ----------
    Dim m As matrix
    m = x

    Dim test(m.ColumnCount-1) As Double
    Dim i As Integer
    For i = 1 To m.ColumnCount - 1
      test(i - 1) = m.item(y, i)
    Next

    A = test
# ---------- end vb ----------
panel_11 = Panel(vb.A)
visumshsol = VisualizeMeshSolar(Mesh=mesh_uv, I=irrmshy.IAnnual, Clr=Slider(1, range=0..2))
